# Grasshopper definition slicer.gh (Grasshopper 1.0.7)

geo = Geometry()
pt = Point()
shrinkage = Slider(0, range=0..1)
bottom_layers = Slider(4, range=1..50)
initial_layer_height = Slider(0.1, range=0..1)
wall_mode = BooleanToggle(False)
fill_bottom = BooleanToggle(False)
speed = Slider(1000, range=100..9000)
extrude_rate = Slider(1, range=0..2.5)
extrude_width = Slider(2.24, range=0..2.5)
nozzle_width = Slider(0.01, range=0.01..15)
nozzle_height = Slider(40.4, range=0..50)
walls = Slider(4, range=1..50)
layer_height = Slider(1, range=0..1)
list = ValueList({"Ender": "ender", "Eazao": "eazao"}, selected="Eazao")
bed_temp = Slider(60, range=0..150)
extruder_temp = Slider(225, range=0..300)
dam = DataDam(DataA=shrinkage, BufferDelay=10000000, BufferMode=0)
shrink_resize = ShrinkResize(relay=geo, x=dam)
dam_2 = DataDam(
    DataPrinter=list,
    DataSpeedMmMin=speed,
    DataBedTemp=bed_temp,
    DataExtruderTemp=extruder_temp,
    DataExtrudeRate=extrude_rate,
    DataInitialLayerHeightMm=initial_layer_height,
    DataExtrudeWidthMm=extrude_width,
    DataNozzleWidthMm=nozzle_width,
    DataNozzleHeightMm=nozzle_height,
    DataWallMode=wall_mode,
    DataFillBottom=fill_bottom,
    DataWalls=walls,
    DataBottomLayers=bottom_layers,
    DataStartPointOptional=pt,
    BufferDelay=10000000,
    BufferMode=0)  # -> DataPrinter, DataSpeedMmMin, DataBedTemp, DataExtruderTemp, DataExtrudeRate, DataInitialLayerHeightMm, DataExtrudeWidthMm, DataNozzleWidthMm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
dam_3 = DataDam(DataModel=flatten(shrink_resize), DataLayerHeight=layer_height, BufferDelay=10000000, BufferMode=0)  # -> DataModel, DataLayerHeight
trigger = Trigger(Interval=-1000, TimerInterval=1000, Target=python)
python = GhPythonScript()  # -> out, file
# ---------- python: Python ----------
import rhinoscriptsyntax as rs

filter = "GCode (*.gcode)|*.gcode|All Files (*.*)|*.*||"
file = rs.SaveFileName("", filter)
# ---------- end python ----------
contour = Contour(Shape=flatten(dam_3.DataModel), Point=Point(0, 0, 0), Direction=Vector(0, 0, 1), Distance=dam_3.DataLayerHeight)
dam_4 = DataDam(DataA=python.file, BufferDelay=10000000, BufferMode=0)
python_2 = GhPythonScript(
    filename=dam_4,
    shape=flatten(dam_3.DataModel),
    contour_tree=contour,
    layer_height=dam_3.DataLayerHeight,
    printer=dam_2.DataPrinter,
    speed=dam_2.DataSpeedMmMin,
    bed_temp=dam_2.DataBedTemp,
    extruder_temp=dam_2.DataExtruderTemp,
    extrude_rate=dam_2.DataExtrudeRate,
    initial_layer_height=dam_2.DataInitialLayerHeightMm,
    extrude_width=dam_2.DataExtrudeWidthMm,
    nozzle_width=dam_2.DataNozzleWidthMm,
    nozzle_height=dam_2.DataNozzleHeightMm,
    wall_mode=dam_2.DataWallMode,
    fill_bottom=dam_2.DataFillBottom,
    walls=dam_2.DataWalls,
    bottom_layers=dam_2.DataBottomLayers,
    start_point=dam_2.DataStartPointOptional)  # -> out, lines, turtle, print_bed, outer_travel, inner_travel; inputs shape: list, contour_tree: tree of Curve, start_point: Point3d
# ---------- python_2: Python ----------
# code required so that library reloads appropriately
# must be above other import statements
import sys
import math
import time
import operator as op
import ghpythonlib.treehelpers as th
to_delete = list()
for module in sys.modules:
    if "TRAvel_Slicer" in module:
      to_delete.append(module)
    if "extruder_turtle" in module:
      to_delete.append(module)
    if "turtle_utilities" in module:
      to_delete.append(module)
    if "contour_utils" in module:
      to_delete.append(module)
    if "geometry_utils" in module:
      to_delete.append(module)
    if "outer_travel_utils" in module:
      to_delete.append(module)
for module in to_delete:
    sys.modules.pop(module)

import TRAvel_Slicer
from TRAvel_Slicer import *

import extruder_turtle
from extruder_turtle import *

import turtle_utilities as tu

import Rhino
import rhinoscriptsyntax as rs

reload(TRAvel_Slicer)
reload(extruder_turtle)


# Main code
# set up the turtle
t = ExtruderTurtle()

# set all parameters
t.setup(filename=filename, printer=printer)

if printer=="ender":
    t.set_extruder_temp(extruder_temp)
    t.set_bed_temp(bed_temp)

t.set_speed(speed)
t.set_extrude_rate(extrude_rate)
t.set_extrude_width(extrude_width)
t.set_layer_height(layer_height)

t.set_nozzle_height(nozzle_height)
t.set_nozzle_width(nozzle_width)

t.print_printer_information()
print("nozzle height: "+str(nozzle_height))
print("nozzle width: "+str(nozzle_width))

# if optional start point included, move there first
if start_point != None:
    t.pen_up()
    t.set_position(start_point.X, start_point.Y, 0)
    t.pen_down()

st_pnt = t.get_position()

# turn curves in Grasshopper tree data
# structure into list of lists
curves = []
for i in range(contour_tree.BranchCount):
    crvs = [crv for crv in contour_tree.Branch(i) if crv and rs.IsCurve(crv) and rs.IsCurveClosed(crv)]
    if len(crvs) > 0: curves.append(crvs)


# translate curves and shape to initial layer height
translate = rs.CreateVector(0, 0, initial_layer_height)
for i in range(len(curves)):
    rs.MoveObject(curves[i], translate)

rs.MoveObject(shape, translate)


# Slice with TRAvel_Slicer
outer_travel, inner_travel, tree, node_path, path, edges = TRAvel_Slice(t, shape, curves, wall_mode=wall_mode, walls=walls, fill_bottom=fill_bottom, bottom_layers=bottom_layers, initial_offset=0.0, separate_wall=False, debug=True)

# visualize the turtle's path
turtle = t.draw_turtle()
lines = t.get_lines()
print_bed = t.draw_print_bed()


# close the generated .gcode file
t.finish()

print("Print time: "+str(t.get_print_time()))
# ---------- end python_2 ----------
trigger_2 = Trigger(Interval=-1000, TimerInterval=1000, Target=python_2)
crv = Curve(python_2.lines)
geo_2 = Geometry(python_2.turtle)
srf = Surface(python_2.print_bed)
crv_2 = Curve(python_2.outer_travel)
crv_3 = Curve(python_2.inner_travel)
panel = Panel(python_2.out)

# ==== cluster ShrinkResize
relay = ClusterInput()
x = ClusterInput()
area = Area(Geometry=relay)  # -> Area, Centroid
eval = Evaluate(F="1/(1-x)", x=x)
pt2num = PointsToNumbers(Points=area.Centroid, Mask=4)
item = ListItem(List=pt2num, Index=0, Wrap=True)
item_2 = ListItem(List=pt2num, Index=1, Wrap=True)
vec = VectorXYZ(XComponent=item, YComponent=item_2, ZComponent=0)  # -> Vector, Length
scale = Scale(Geometry=relay, Center=vec.Vector, Factor=eval)  # -> Geometry, Transform
G = ClusterOutput(scale.Geometry)
