# Grasshopper definition slicer.gh (Grasshopper 1.0.7)

shrinkage = Slider(0, range=0..1)
trigger = Trigger(Interval=-1000, TimerInterval=1000, Target=python)
geo = Geometry(<brep referenced from the Rhino model>)
shrink_resize = ShrinkResize(relay=geo, x=shrinkage)
geo_2 = Geometry(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)
python = GhPythonScript()  # -> out, file
# ---------- python: Python ----------
import rhinoscriptsyntax as rs

filter = "GCode (*.gcode)|*.gcode|All Files (*.*)|*.*||"
file = rs.SaveFileName("", filter)
# ---------- end python ----------
pt = Point(<point referenced from the Rhino model>)
crv = Curve([<curve referenced from the Rhino model> x2])
dam = DataDam(DataB=shrink_resize, DataC=pt, DataA=crv, BufferDelay=10000000, BufferMode=0)  # -> DataB, DataC, DataA
dam_2 = DataDam(DataA=python.file, BufferDelay=10000000, BufferMode=0)
python_2 = GhPythonScript(filename=dam_2, shape=dam.DataB, start_point=dam.DataC, curves=dam.DataA)  # -> out, lines, turtle, print_bed, travel, tree, path, edge_start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; inputs shape: Brep, start_point: Point3d, curves: list
# ---------- python_2: Python ----------
# code required so that library reloads appropriately
# must be above other import statements
import sys
import math
import time
import operator as op
to_delete = list()
for module in sys.modules:
    if "tree_utils" in module:
      to_delete.append(module)
    if "graph_utils" in module:
      to_delete.append(module)
    if "image_utils" in module:
      to_delete.append(module)
    if "contour_utils" in module:
      to_delete.append(module)
    if "geometry_utils" in module:
      to_delete.append(module)
    if "vertical_utils" in module:
      to_delete.append(module)
    if "slicing_utils" in module:
      to_delete.append(module)
    if "extruder_turtle" in module:
      to_delete.append(module)
    if "turtle_utilities" in module:
      to_delete.append(module)
for module in to_delete:
    sys.modules.pop(module)

import slicing_utils
from slicing_utils import *

import vertical_utils
from vertical_utils import *

import extruder_turtle
from extruder_turtle import *

import turtle_utilities as tu

import Rhino
import rhinoscriptsyntax as rs

reload(slicing_utils)
reload(extruder_turtle)


# Main code
# set up the turtle
t = ExtruderTurtle()
t.setup(filename=filename, printer = "eazao")

# metal settings
#t.set_material('metal')
#t.set_layer_height(0.3)

#t.set_extrude_width(1.0)
#t.set_extrude_rate(0.5)

print("layer height is: " +str(t.get_layer_height()))
print("extrude rate is: "+str(t.get_extrude_rate()))
print("extrusion width is: "+str(t.get_extrude_width()))

layer_height = t.get_layer_height()

if start_point != None:
    t.pen_up()
    t.set_position(start_point.X, start_point.Y, 0)
    t.pen_down()

# draw
#travel = slice_fermat_fill(t, shape)
#travel = slice_fermat_fill(t, shape, wall_mode=True, walls=2)
#travel = slice_fermat_fill(t, shape, start=15, end=19)
#travel = slice_spiral_fill(t, shape, start=6, end=9)
#travel = slice_contour_fill(t, shape, start=5, end=7)
#travel = slice_2_half_D_fermat(t, curves, layers=1)

#tree, path, center_points, bounding_boxes, edges = best_vertical_path(t, shape)
#travel, tree, path, center_points, bounding_boxes, edges = slice_vertical_and_fermat_fill(t, shape, wall_mode=True, walls=3, fill_bottom=True)


#edge_start = [rs.CurveStartPoint(edge) for edge in edges]
#edge_end = [rs.CurveEndPoint(edge) for edge in edges]

#travel = []
#for layer in range(int(get_shape_height(shape)/t.get_layer_height())+1):
#    curves = get_curves(shape, layer*t.get_layer_height())
#    for group in curves:
#        for curve in group:
#            print(layer, curve)
#            print(rs.ObjectType(curve))
#            travel.append(curve)


# visualize the turtle's path
#turtle = t.draw_turtle()
lines = t.get_lines()
print_bed = t.draw_print_bed()

# close the generated .gcode file
t.finish()
# ---------- end python_2 ----------
python_3 = GhPythonScript(x=geo_2, shape=shrink_resize, layer=Slider(102, range=0..200), height=python_2.layer_height)  # -> out, a
# ---------- python_3: Python ----------
import rhinoscriptsyntax as rs

a = rs.AddSrfContourCrvs(shape, rs.PlaneFromNormal([0, 0, layer*0.3], [0, 0, 1]))
# ---------- end python_3 ----------
geo_3 = Geometry(python_3.a)
crv_2 = Curve(python_2.travel)
crv_3 = Curve(python_2.lines)
srf = Surface(python_2.print_bed)
cluster = Cluster_2(path=python_2.path, center_points=python_2.center_points, index=Slider(35, range=1..200))
panel = Panel(python_2.out)
subtraction = Subtraction(A=python_2.edge_end, B=python_2.edge_start)
pt_2 = Point(python_2.center_points)
geo_4 = Geometry(python_2.bounding_boxes)
crv_4 = Curve(python_2.connected_curve)
python_4 = GhPythonScript(tree=python_2.tree, boxes=python_2.bounding_boxes)  # -> out, a; inputs boxes: list
# ---------- python_4: Python ----------
import rhinoscriptsyntax as rs

import vertical_utils
from vertical_utils import *

def print_node_recurse(node, depth=0):
    print(depth, node.data)
    print("number of children: "+ str(len(node.children)))
    for child in node.children:
        print_node_recurse(child, depth+1)

print(tree)
print_node_recurse(tree)

width = 8

for b1 in range(len(boxes)):
    box1 = boxes[b1]
    for b2 in range(len(boxes)):
        box2 = boxes[b2]
        if b1 != b2:
            w = width/2

            bbox1 = rs.BoundingBox(box1)
            minX1 = bbox1[0].X - w
            minY1 = bbox1[0].Y - w
            maxX1 = bbox1[2].X + w
            maxY1 = bbox1[2].Y + w
            bbox2 = rs.BoundingBox(box2)
            minX2 = bbox2[0].X - w
            minY2 = bbox2[0].Y - w
            maxX2 = bbox2[2].X + w
            maxY2 = bbox2[2].Y + w
            if minX1 < maxX2 and maxX1 > minX2 and minY1 < maxY2 and maxY1 > minY2:
                print(str(b1) + " is overlapping " + str(b2))
# ---------- end python_4 ----------
vdis = VectorDisplay(Anchor=python_2.edge_start, Vector=subtraction)
geo_5 = Geometry(cluster)
cluster_2 = Cluster(N=Slider(500, range=0..1000), B=Slider(0, range=0..15000))

# ==== cluster Cluster
C = ClusterInput()
N = ClusterInput()
B = ClusterInput()
join = JoinCurves(Curves=C, Preserve=False)
divide = DivideCurve(Curve=join, Count=N, Kinks=False)  # -> flatten(Points), Tangents, Parameters
dom = ConstructDomain(DomainStart=0, DomainEnd=B)
subset = SubList(List=divide.Points, Domain=dom, Wrap=True)  # -> List, Index
intcrv = Interpolate(Vertices=subset.List, Degree=3, Periodic=False, KnotStyle=1)  # -> Curve, Length, Domain

# ==== cluster Cluster_2
path = ClusterInput()
center_points = ClusterInput()
index = ClusterInput()
geo = Geometry(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)
python = GhPythonScript(path=path, center_points=center_points, index=index, nozzle=geo)  # -> travel, new_nozzle; inputs path: list, center_points: list, index: Int32
# ---------- python: Python ----------
__author__ = "school"

import rhinoscriptsyntax as rs

travel = []

print(path)

for node in path:
    for sub in node.data.sub_nodes:
        travel.append(sub.start_point)

new_nozzle = rs.CopyObject(nozzle, translation=travel[min(index, len(travel)-1)])
# ---------- end python ----------
new_nozzle = ClusterOutput(python.new_nozzle)

# ==== cluster ShrinkResize
relay = ClusterInput()
x = ClusterInput()
area = Area(Geometry=relay)  # -> Area, Centroid
eval = Evaluate(F="1/(1-x)", x=x)
pt2num = PointsToNumbers(Points=area.Centroid, Mask=4)
item = ListItem(List=pt2num, Index=0, Wrap=True)
item_2 = ListItem(List=pt2num, Index=1, Wrap=True)
vec = VectorXYZ(XComponent=item, YComponent=item_2, ZComponent=0)  # -> Vector, Length
scale = Scale(Geometry=relay, Center=vec.Vector, Factor=eval)  # -> Geometry, Transform
G = ClusterOutput(scale.Geometry)
