# Grasshopper definition slicer_simple.gh (Grasshopper 1.0.7)

trigger = Trigger(Interval=-1000, TimerInterval=1000, Target=python)
python = GhPythonScript()  # -> out, file
# ---------- python: Python ----------
import rhinoscriptsyntax as rs

filter = "GCode (*.gcode)|*.gcode|All Files (*.*)|*.*||"
file = rs.SaveFileName("", filter)
# ---------- end python ----------
pt = Point(<point referenced from the Rhino model>)
geo = Geometry(<brep referenced from the Rhino model>)
dam = DataDam(DataB=pt, DataA=geo, BufferDelay=10000000, BufferMode=0)  # -> DataB, DataA
dam_2 = DataDam(DataA=python.file, BufferDelay=10000000, BufferMode=0)
python_2 = GhPythonScript(filename=dam_2, start_point=dam.DataB, shape=dam.DataA)  # -> out, lines, turtle, print_bed, travel; inputs start_point: Point3d, shape: Brep
# ---------- python_2: Python ----------
# code required so that library reloads appropriately
# must be above other import statements
import sys
import math
import time
import operator as op
to_delete = list()
for module in sys.modules:
    if "tree_utils" in module:
      to_delete.append(module)
    if "graph_utils" in module:
      to_delete.append(module)
    if "geometry_utils" in module:
      to_delete.append(module)
    if "vertical_utils" in module:
      to_delete.append(module)
    if "slicing_utils" in module:
      to_delete.append(module)
    if "extruder_turtle" in module:
      to_delete.append(module)
    if "turtle_utilities" in module:
      to_delete.append(module)
for module in to_delete:
    sys.modules.pop(module)

import slicing_utils
from slicing_utils import *

import vertical_utils
from vertical_utils import *

import extruder_turtle
from extruder_turtle import *

import turtle_utilities as tu

import Rhino
import rhinoscriptsyntax as rs

reload(slicing_utils)
reload(extruder_turtle)


# Main code
# set up the turtle
t = ExtruderTurtle()
t.setup(filename=filename, printer = "eazao")

t.set_nozzle_size(0.6)
t.set_extrude_rate(0.25)
t.set_mix_factor(0.97)
t.set_layer_height(0.4)
t.set_extrude_width(0.8)
t.set_speed(800)

print("standard layer height is: " +str(t.get_layer_height()))
print("standard extrusion width is: "+str(t.get_extrude_width()))

# start point
if start_point:
    print(start_point)
    t.set_position(start_point.X, start_point.Y, 0)

# draw
#travel = slice_fermat_fill(t, shape, wall_mode=True, walls=2, fill_bottom=True, bottom_layers=2)
#travel = slice_fermat_fill(t, shape)
#travel = slice_spiral_fill(t, shape, start=0, end=1)
#travel = slice_contour_fill(t, shape, start=0, end=1)
#travel, center_points = slice_vertical_and_fermat_fill(t, shape, wall_mode=True, walls=2, fill_bottom=True)

# visualize the turtle's path
#turtle = t.draw_turtle()
lines = t.get_lines()
print_bed = t.draw_print_bed()

# close the generated .gcode file
t.finish()
# ---------- end python_2 ----------
crv = Curve(python_2.lines)
srf = Surface(python_2.print_bed)
crv_2 = Curve(python_2.travel)
